# Grasshopper definition gcode_wave.gh (Grasshopper 1.0.8)

# ---- group: Input geometry
geo = Geometry(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)

# ---- group: Bed size
X = Slider(180, range=0..500)
Y = Slider(180, range=0..500)
Z = Slider(180, range=0..500)

# ----
wave_num_even = Slider(60, range=0..100)
layer_height = Slider(0.6, range=0..3)
seam = Slider(0.5, range=0..1)
resolution = Slider(0.75, range=0.05..10)

# ---- group: For Extrusion
layer_heigth = Slider(0.4, range=0..1)
filament_dia = Slider(1.75, range=0..4)
line_width = Slider(0.82, range=0..1)
multiplier = Slider(1, range=0..100)

# ----
# 2. Crv to Pt
number_slider = Slider(0.7133, range=0..1)
speed_mm_s = Slider(20, range=0..100)
z_shift_mm = Slider(0.2, range=0..1)
expression = Expression(x=speed_mm_s, Expression="x*60")
start_protocol_a1_mini_petg = Panel("""; --- OPTIMIZED START PROTOCOL ---
G90 ; Set positioning mode to Absolute
M82 ; Set extruder to Absolute mode
M106 S128 ; Turn part cooling fan to 50%
; 1. Preheating (Prevent oozing during homing)
M140 S75 ; Set bed temperature to 75C (non-blocking)
M104 S170 ; Set nozzle standby temperature to 170C (non-blocking)
M190 S75 ; Wait for bed temperature to reach 75C
M109 S170 ; Wait for nozzle standby temperature
; 2. Homing & Positioning
G28 ; Home all axes (X, Y, Z)
M420 S1 ; Enable Auto Bed Leveling mesh if available
G1 Z5 F3000 ; Lift nozzle 5mm to prevent bed collision
G1 X5 Y10 F5000 ; Move quickly to prime line start position (X=5, Y=10)
; 3. Final Nozzle Heating
M104 S240 ; Set target nozzle temperature to 240C
M109 S240 ; Wait for nozzle temperature to reach 240C
; 4. Purge Line (Prime & Clean for A1 mini purge tab)
G1 Z5 F3000
G1 X65 Y-10 F3000 ; Rapid move to purge tab left side
G1 Z0.1 F200     ; Lower nozzle to purge position
G92 E0            ; Reset extruder count
G1 X115 E15 F200 ; Purge while moving to X=115 (extrude 15mm)
G1 X125 F3000    ; Rapid move to the right to break the filament tail (wipe)
G1 Z1.0 F1000     ; Lift 1mm
; 5. Transition to Print
G92 E0 ; Reset extrusion distance counter for main print
; --- END OF START PROTOCOL ---""")
end_protocol_a1_mini = Panel("""; --- OPTIMIZED END PROTOCOL ---
; 1. Retract & Safe Z-Hop
G92 E0 ; Reset extrusion distance counter
G1 E-2 F1800 ; Retract 2mm filament to prevent oozing/stringing
G91 ; Switch to Relative positioning mode
G1 Z5 F3000 ; Lift Z axis by 5mm relative to current position
G90 ; Switch back to Absolute positioning mode
; 2. Park Carriage & Present Print
G28 X0 ; Home X axis
G1 Y170 F3000 ; Move Y axis forward to present the printed part (adjust Y value as needed)
; 3. Cooldown & Power Down
M106 S0 ; Turn off part cooling fan
M104 S0 ; Turn off nozzle heater
M140 S0 ; Turn off bed heater
M84 ; Disable stepper motors (X, Y, Z, E)
; --- END OF END PROTOCOL ---""")

# ---- group: Moving object to the heatbed center
bbox = BoundingBox(Content=geo, Plane=PlaneXY(0, 0, 0), UnionBox=True)  # -> Box, Box_2
volume = Volume(Geometry=bbox.Box)  # -> Volume, Centroid
debox = DeconstructBox(Box=bbox.Box)  # -> Plane, X, Y, Z
pdecon = Deconstruct(Point=volume.Centroid)  # -> XComponent, YComponent, ZComponent

# ----
panel = Panel(debox.X)
panel_2 = Panel(debox.Y)
panel_3 = Panel(debox.Z)

# ---- group: 3D Printer: Printing Area
rectangle = Rectangle(Plane=PlaneXY(0, 0, 0), XSize=X, YSize=Y, Radius=0)  # -> Rectangle, Length
expression_2 = Expression(x=X, Expression="x/2")
expression_3 = Expression(x=Y, Expression="x/2")
boxrec = BoxRectangle(Rectangle=rectangle.Rectangle, Height=Z)
pt = ConstructPoint(XCoordinate=expression_2, YCoordinate=expression_3, ZCoordinate=0)
edges = BrepEdges(Brep=boxrec)  # -> Naked, Interior, NonManifold
panel_4 = Panel(pt)

# ---- group: Moving object to the heatbed center (continued)
dedomain = DeconstructDomain(Domain=panel_3)  # -> Start, End
pt_2 = ConstructPoint(XCoordinate=pdecon.XComponent, YCoordinate=pdecon.YComponent, ZCoordinate=dedomain.Start)

# ---- group: 3D Printer: Printing Area (continued)
vec2pt = Vector2Pt(PointA=pt_2, PointB=panel_4, Unitize=False)  # -> Vector, Length

# ---- group: Moving object to the heatbed center (continued)
move = Move(Geometry=geo, Motion=vec2pt.Vector)  # -> Geometry, Transform

# ----
geo_2 = Geometry(move.Geometry)

# ---- group: Planner Contours
Z_2 = UnitZ(Factor=1)
# 1. Geometry to Curve
contour = Contour(Shape=geo_2, Point=Point(0, 0, 0), Direction=Z_2, Distance=layer_height)  # -> flatten(Contours)

# ---- group: Delete the last curve if the number of curves is odd
py3 = Python3Script(curves=contour)  # -> out, out_curves; inputs curves: list of Curve
# ---------- py3: Python ----------
if curves:
    count = len(curves)

    if count % 2 != 0:
        out_curves = curves[:-1]
    else:
        out_curves = curves
else:
    out_curves = []
# ---------- end py3 ----------

# ---- group: Adjust seam
lng = ListLength(List=py3.out_curves)
expression_4 = Expression(x=lng, Expression="x-1")
range = Range(Domain=seam, Steps=expression_4)
seam_2 = Seam(Curve=reparameterize(py3.out_curves), Seam=range)

# ----
dispatch = Dispatch(List=seam_2, DispatchPattern=[True, False])  # -> ListA, ListB
divide = DivideCurve(Curve=dispatch.ListA, Count=wave_num_even, Kinks=False)  # -> simplify(Points), Tangents, Parameters
divide_2 = DivideCurve(Curve=dispatch.ListB, Count=wave_num_even, Kinks=False)  # -> simplify(Points), Tangents, Parameters
dispatch_2 = Dispatch(List=divide.Points, DispatchPattern=[True, False])  # -> ListA, ListB
dispatch_3 = Dispatch(List=divide_2.Points, DispatchPattern=[True, False])  # -> ListA, ListB

# ---- group: Move to the point on the line above
vec2pt_2 = Vector2Pt(PointA=dispatch_2.ListB, PointB=dispatch_3.ListB, Unitize=False)  # -> Vector, Length
vec2pt_3 = Vector2Pt(PointA=dispatch_2.ListA, PointB=dispatch_3.ListA, Unitize=False)  # -> Vector, Length
move_2 = Move(Geometry=dispatch_2.ListB, Motion=vec2pt_2.Vector)  # -> Geometry, Transform
move_3 = Move(Geometry=dispatch_3.ListA, Motion=vec2pt_3.Vector)  # -> Geometry, Transform

# ----
weave = Weave(Pattern=[0, 1], Stream0=dispatch_2.ListA, Stream1=move_2.Geometry, NullGaps=False)
weave_2 = Weave(Pattern=[0, 1], Stream0=move_3.Geometry, Stream1=dispatch_3.ListB, NullGaps=False)
intcrv = Interpolate(Vertices=weave, Degree=3, Periodic="True", KnotStyle=1)  # -> Curve, Length, Domain
intcrv_2 = Interpolate(Vertices=weave_2, Degree=3, Periodic="True", KnotStyle=1)  # -> Curve, Length, Domain
weave_3 = Weave(Pattern=[0, 1], Stream0=intcrv.Curve, Stream1=intcrv_2.Curve, NullGaps=False)  # -> flatten(Weave)

# ---- group: Add one base line for adhesion
item = ListItem(List=seam_2, Index=0, Wrap=True)
ins = InsertItems(List=weave_3, Item=item, Indices="0", Wrap=True)

# ----
crv = Curve(ins)

# ---- group: Dividing Contours into Small Segments
divdist = DivideDistance(Curve=crv, Distance=resolution)  # -> flatten(Points), Tangents, Parameters

# ----
pt_3 = Point(divdist.Points)

# ---- group: Calculating Length of Segments
# 3. Pt to Cordinate
pline = PolyLine(Vertices=pt_3, Closed=False)
explode = Explode(Curve=pline, Recursive=True)  # -> Segments, Vertices
len = Length(Curve=explode.Segments)

# ---- group: Extrusion amount
# Extrusion amount =
# 
#   Extrusion cross-sectional area
#   (Layer height x Line width)
#   ________________________________ x Multiplier x Length
# 
#   Filament cross-sectional area
expression_5 = Expression(x=filament_dia, Expression="(x/2)²*π")
multiplication = Multiplication(A=layer_heigth, B=line_width)
filament_area = Panel(expression_5)
line_area = Panel(multiplication)
division = Division(A=line_area, B=filament_area)
multiplication_2 = Multiplication(A=division, B=multiplier)
multiplication_3 = Multiplication(A=len, B=multiplication_2)

# ---- group: Path preview
crv_2 = Curve(pline)
eval = EvaluateCurve(Curve=reparameterize(crv_2), Parameter=number_slider)  # -> Point, Tangent, Angle

# ---- group: Generating G-code for Printing Segments / Converting from Relative to Absolute Extrusion
ma = MassAddition(Input=multiplication_3)  # -> Result, PartialResults

# ---- group: Generating G-code for Printing Segments
# 4. Format
pdecon_2 = Deconstruct(Point=pt_3)  # -> XComponent, YComponent, ZComponent
addition = Addition(A=pdecon_2.ZComponent, B=z_shift_mm)
concat = Concatenate(
    FragmentH="G1 ",
    FragmentG="F",
    FragmentL=expression,
    FragmentA=" X",
    FragmentB=pdecon_2.XComponent,
    FragmentC=" Y",
    FragmentD=pdecon_2.YComponent,
    FragmentE=" Z",
    FragmentF=addition,
    FragmentJ=" E",
    FragmentK=ma.PartialResults)

# ----
panel_5 = Panel(concat)
merge = Merge(Data1=flatten(start_protocol_a1_mini_petg), Data2=flatten(panel_5), Data3=flatten(end_protocol_a1_mini))
# * Stream Contents ✓
# * Stream Destination > [filename.gcode]
g_code = Panel(merge)
