# Grasshopper definition imu_sonic_serial.gh (Grasshopper 1.0.8)
# plug-ins: Pufferfish

trigger = Trigger(Interval=100, TimerInterval=100, Target=imu_sonic_serial)  # disabled
imu_sonic_serial = Python3Script(port="/dev/cu.usbmodem14101", baud="115200", run=Toggle(True))  # -> raw_data, accel, gyro, gravity_vec, distance, msg; inputs port: String, baud: Int32, run: Boolean
# ---------- imu_sonic_serial: Python ----------
# r: pyserial
import serial
import time
import Rhino.Geometry as rg

# Initialize outputs
raw_data = []
accel = [0.0, 0.0, 0.0]        # Acceleration [g] (X, Y, Z)
gyro = [0.0, 0.0, 0.0]         # Angular velocity [deg/s] (X, Y, Z)
distance = -1.0                # Ultrasonic distance [cm]
gravity_vec = rg.Vector3d(0, 0, 1) # Gravity vector (Rhino Vector3d)
msg = ""

# Sensitivity scale factors (MPU6050 default settings)
ACCEL_SCALE = 16384.0  # LSB per 1g in ±2g range
GYRO_SCALE = 131.0     # LSB per 1deg/s in ±250deg/s range

# Retain global variables
if 'ser' not in globals():
    ser = None

if run:
    try:
        # Connect to port
        if ser is None or not ser.is_open:
            ser = serial.Serial(port, int(baud), timeout=0.1)
            time.sleep(0.2) # Wait for connection to stabilize
            msg = "Connected to {}".format(port)
        else:
            msg = "Port active"

        # Read all accumulated data in the buffer and get the latest line
        lines = []
        while ser.in_waiting > 0:
            raw_line = ser.readline()
            try:
                decoded = raw_line.decode('utf-8').strip()
                if decoded:
                    lines.append(decoded)
            except:
                pass

        # Parse the latest data and convert to physical units
        if lines:
            latest_line = lines[-1]
            parts = latest_line.split(',')
            if len(parts) == 7: # IMU(6) + Ultrasonic(1) = 7 elements
                # Convert IMU data to integers and distance to float
                raw_data = [int(p) for p in parts[:6]]
                distance = float(parts[6])
                
                # --- Scale 16-bit raw data to physical units ---
                # 1. Acceleration [g]
                ax = raw_data[0] / ACCEL_SCALE
                ay = raw_data[1] / ACCEL_SCALE
                az = raw_data[2] / ACCEL_SCALE
                accel = [ax, ay, az]

                # 2. Angular velocity [deg/s]
                gx = raw_data[3] / GYRO_SCALE
                gy = raw_data[4] / GYRO_SCALE
                gz = raw_data[5] / GYRO_SCALE
                gyro = [gx, gy, gz]

                # 3. Gravity vector (Vector3d directly usable in Rhino 3D space)
                gravity_vec = rg.Vector3d(ax, ay, az)

                msg = "Receiving: " + latest_line
            else:
                msg = "Malformed line: " + latest_line
        else:
            msg = "Waiting for data..."

    except Exception as e:
        msg = "Error: {}".format(str(e))
        if ser and ser.is_open:
            ser.close()
            ser = None
else:
    if ser and ser.is_open:
        ser.close()
        ser = None
        msg = "Disconnected"
# ---------- end imu_sonic_serial ----------
vec = Vector(imu_sonic_serial.gravity_vec)
pt = Point([Point(-30.41801847, 0, 2.136213116), Point(-64.48073398, 0, 21.33519822), Point(-22.36683117, 0, 50.44333692), Point(-67.88700553, 0, 130.9552099), Point(-21.12818697, 0, 146.1286014), Point(-27.94073007, 0, 165.6372475)])
line = LineSDL(Start="0,0,0", Direction=vec, Length="200")
nurbs = NurbsCurve(Vertices=pt, Degree=3, Periodic=False)  # -> Curve, Length, Domain
ln = Line(StartPoint="0,0,0", EndPoint="0,0,200")
panel = Panel(imu_sonic_serial.raw_data)
panel_2 = Panel(imu_sonic_serial.accel)
panel_3 = Panel(imu_sonic_serial.gyro)
panel_4 = Panel(imu_sonic_serial.gravity_vec)
panel_5 = Panel(imu_sonic_serial.distance)
panel_6 = Panel(imu_sonic_serial.msg)
rebcrv = RebuildCurve(Curve=ln, Count="3", Degree="2", EndTangents=False)
rebcrv_2 = RebuildCurve(Curve=line, Count="3", Degree="2", EndTangents=False)
revsrf = Revolution(Curve=nurbs.Curve, Axis=ln, Domain=Domain(0, 6.283185307))
cp = ControlPoints(Curve=rebcrv)  # -> Points, Weights, Knots
cp_2 = ControlPoints(Curve=rebcrv_2)  # -> Points, Weights, Knots
cap = CapHoles(Brep=revsrf)
item = ListItem(List=cp.Points, Index=0, Wrap=True)  # -> Item, Item1, Item2
item_2 = ListItem(List=cp_2.Points, Index=0, Wrap=True)  # -> Item, Item1, Item2
debrep = DeconstructBrep(Brep=cap)  # -> Faces, Edges, Vertices
cull_i = CullIndex(List=debrep.Faces, Indices="-1", Wrap=True)
merge = Merge(Data1=item.Item, Data2=item.Item1, Data3=item_2.Item2)
join = BrepJoin(Breps=cull_i)  # -> Breps, Closed
qrsettings = QuadRemeshSettings(
    TargetCount=Slider(800, range=0..10000),
    AdaptiveSize=0,
    AdaptiveCount=False,
    HardEdges=False,
    SeamEdges=0,
    Symmetry=0,
    GuideCurves=0)
nurbs_2 = NurbsCurve(Vertices=merge, Degree="2", Periodic=False)  # -> Curve, Length, Domain
qrmesh = QuadRemesh(Geometry=join.Breps, Settings=qrsettings)
flow = Flow(Geometry=qrmesh, Base=ln, Target=nurbs_2.Curve, ReverseBase=False, ReverseTarget=False, Stretch=True, Rigid=False)
dom = ConstructDomain(DomainStart=Slider(20, range=0..100), DomainEnd=Slider(100, range=0..100))
dom_2 = ConstructDomain(DomainStart=Slider(0, range=0..100), DomainEnd=Slider(25, range=0..100))
remap = RemapNumbers(Value=panel_5, Source="0 to 100", Target=dom)  # -> Mapped, Clipped
remap_2 = RemapNumbers(Value=panel_5, Source="0 to 100", Target=dom_2)  # -> Mapped, Clipped
X = UnitX(Factor=1)
mesh_wavy_deform = Python3Script(mesh=flow, w1=remap.Mapped, w2=remap.Mapped, h=remap_2.Mapped, vec=X)  # -> new_mesh; inputs mesh: Mesh, w1: Double, w2: Double, h: Double, vec: Vector3d
# ---------- mesh_wavy_deform: Python ----------
import Rhino.Geometry as rg
import math

def ocean_wave(mesh, w1, w2, h, vec):
    # --- 1. Normalize the propagation direction vector for Wave 1 ---
    d_vec1 = rg.Vector3d(vec[0], vec[1], vec[2])
    d_vec1.Unitize()

    # Reference axis (Z-axis, or X-axis if parallel to Z-axis)
    o_axis = rg.Vector3d(0, 0, 1)
    if abs(d_vec1.Z) > 0.99:
        o_axis = rg.Vector3d(1, 0, 0)

    # Orthogonal axis of Wave 1 (for position calculation)
    o_vec1 = rg.Vector3d.CrossProduct(d_vec1, o_axis)
    o_vec1.Unitize()

    # --- 2. Calculate Wave 2 vector (90-degree orthogonal) ---
    o_vec2 = rg.Vector3d.CrossProduct(d_vec1, o_vec1)
    o_vec2.Unitize()

    # --- 3. Retrieve mesh vertices and normals ---
    pts = mesh.Vertices.ToPoint3dArray()
    mesh.Normals.ComputeNormals()
    normals = mesh.Normals

    new_pts = []
    for i, p in enumerate(pts):
        # Distances along the axes of Wave 1 and Wave 2
        dist1 = rg.Vector3d(p) * o_vec1
        dist2 = rg.Vector3d(p) * o_vec2

        # Calculate sine waves in two directions
        s1 = math.sin((dist1 / w1) * 2.0 * math.pi)
        s2 = math.sin((dist2 / w2) * 2.0 * math.pi)

        # Interference like ocean surface by multiplication (adjusted to stay within range of -1.0 to 1.0)
        val = h * (s1 * s2)

        # Deform along the normal direction
        n = rg.Vector3d(normals[i])
        new_p = p + n * val
        new_pts.append(new_p)

    # --- 4. Reconstruct the mesh ---
    res_mesh = rg.Mesh()
    for p in new_pts:
        res_mesh.Vertices.Add(p)

    for f in mesh.Faces:
        if f.IsQuad:
            res_mesh.Faces.AddFace(f.A, f.B, f.C, f.D)
        else:
            res_mesh.Faces.AddFace(f.A, f.B, f.C)

    return res_mesh

# Execution (Inputs: mesh, w1, w2, h, vec)
new_mesh = ocean_wave(mesh, w1, w2, h, vec)
# ---------- end mesh_wavy_deform ----------
subdmesh = SubDFromMesh(Mesh=mesh_wavy_deform, Creases=1, Corners=1, Interpolate=False)
preview = CustomPreview(Geometry=subdmesh, Material=ColourSwatch(SwatchColor=RGB(235, 235, 235)))
